# Grasshopper definition test.gh (Grasshopper 0.9.76)
# plug-ins: ForceDiagram

xz = XZPlane(Origin=Point(0, 0, 0))
srf = Surface([<surface referenced from the Rhino model> x8])
crv = Curve([<curve referenced from the Rhino model> x16])
srf_2 = Surface([<surface referenced from the Rhino model> x8])
pt = Point([Point(-15.02302441, 0.1733530076, 0), Point(1.003035678, 18.48885025, 0), Point(13.97651289, 0.5549258668, 0), Point(2.720113545, -15.66192065, 0)])
mirror = Mirror(Geometry=srf_2, Plane=xz)  # -> Geometry, Transform
forcediagram = ForceDiagram(ListSurface1=srf, ListSurface2=srf_2, FixedBoundary=crv, FixedPoints=pt)
